# Grasshopper definition TRABALHO_ALEX_CAROL_LUANA.gh (Grasshopper 1.0.4)

number_slider = Slider(0.78, range=0..10)
number_slider_2 = Slider(0.2, range=0.03..0.2)
radians = Radians(Degrees=Slider(37.73, range=0..360))
xy_plane = XYPlane(Origin=Point(0, 0, 0))
rotate_plane = RotatePlane(Plane=xy_plane, Angle=radians)
unit_z = UnitZ(Factor=number_slider_2)
ghpython_script = GhPythonScript(
    plano=rotate_plane,
    x=Slider(2, range=1..100),
    y=Slider(1, range=1..100),
    H=number_slider,
    dx=Slider(0.163, range=0.03..0.2),
    dy=Slider(0.163, range=0.03..0.2))  # -> out, a, borda, points; inputs plano: Plane
# ---------- ghpython_script: Python ----------
# CAROLINA FERNANDES NOGUEIRA 
# cfn.carolina@gmail.com

# ALEX DE SOUZA LEÃO
# alexleao@gmail.com

# LUANA MICAELA DE CARVALHO GUIMARÃES
# luamicaela@hotmail.com



import rhinoscriptsyntax as rs
from Rhino.Geometry import Point3d, Vector3d, Plane

if plano is None:
    plano = Plane(Point3d(0,0,0), Vector3d(1,0,0), Vector3d(0,1,0))
    
if dy is None:
    dy = dx
    
    
print plano.Origin
plano.XAxis
plano.YAxis
plano.ZAxis
borda = rs.AddRectangle( plano, x, y )
#borda = rs.GetObject(plano,x,y,H)

points = rs.PolylineVertices(borda)[:-1]
print len(points)
dirX = [ 1, -1, -1 , 1]
dirY = [ 1, 1, -1 , -1]

for i in range(len(points)):
    points[i] = points[i] + (dirX[i] * dx) * plano.XAxis + dirY[i]*dy * plano.YAxis

print points
# ---------- end ghpython_script ----------
Z = UnitZ(Factor=number_slider)
# Pilares
pt = Point(ghpython_script.points)
move = Move(Motion=Z)  # -> Geometry, Transform
move_2 = Move(Geometry=pt, Motion=Z)  # -> Geometry, Transform
points = PointList(Points=ghpython_script.points)
extrude = Extrude(Base=ghpython_script.borda, Direction=unit_z)
subtraction = Subtraction(A=number_slider, B=number_slider_2)
panel = Panel(ghpython_script.out)
Z_2 = UnitZ(Factor=subtraction)
ln = Line(StartPoint=pt, EndPoint=move_2.Geometry)
cap_holes = CapHoles(Brep=extrude)
panel_2 = Panel(move_2.Geometry)
colour_cmyk = ColourCMYK(Cyan=0, Magenta=0, Yellow=0, Key=0)
pipe = Pipe(Curve=ln, Radius=Slider(0.03, range=0.01..0.1), Caps="1")
move_3 = Move(Geometry=cap_holes, Motion=Z_2)  # -> Geometry, Transform
panel_3 = Panel(ln)
panel_4 = Panel(pipe)
custom_preview = CustomPreview(Geometry=move_3.Geometry, Material=ColourSwatch(SwatchColor=RGB(202, 187, 159)))
custom_preview_2 = CustomPreview(Geometry=pipe, Material=ColourSwatch(SwatchColor=RGB(80, 89, 68)))
