# Grasshopper definition equipe beth.gh (Grasshopper 0.9.76)
# plug-ins: Python Interpreter

curve = Curve(<curve referenced from the Rhino model>)
python_script = PythonScript(curva=curve, distancia=Slider(0.93, range=0..1))  # -> out, a
# ---------- python_script: Python ----------
import rhinoscriptsyntax as rs

pts = rs.DivideCurveEquidistant(curva, distancia)

Eixos = []
for i in range(len(pts)-1):
    if i%2 ==0:
        eixo = rs.AddLine(pts[i],pts[i+1])
        eixo = rs.ExtendCurveLength (eixo, 0, 2, .2)
        eixo = rs.ExtrudeCurveStraight(eixo,[0,0,0],[0,0,.1])
        
    Eixos.append(eixo)
        



a = Eixos
# ---------- end python_script ----------
