# Grasshopper definition uv.gh (Grasshopper 0.9.64)
# plug-ins: Python Interpreter

u = ColourSwatch(SwatchColor=RGB(2, 4, 255))
v = ColourSwatch(SwatchColor=RGB(225, 0, 0))
md_slider = MDSlider(
    slider_value=Point(0.3064024623, 0.3279255192, 0.5),
    SliderMode=0,
    x_domain=Domain(0, 1),
    y_domain=Domain(0, 1),
    z_domain=Domain(0, 1))

srf = Surface(reparameterize(<surface referenced from the Rhino model>))
srf_2 = Surface(reparameterize(<surface referenced from the Rhino model>))
python = PythonScript(s=srf, uv=md_slider)  # -> out, a, anchor, uVec, vVec; inputs s: Surface, uv: Point3d
# ---------- python: Python ----------
a = s.PointAt(uv[0],uv[1])

anchor = s.PointAt(0,0)
uend = s.PointAt(0.5,0)
vend = s.PointAt(0,0.5)
uVec = uend - anchor
vVec = vend - anchor
# ---------- end python ----------
python_2 = PythonScript(s=srf_2, uv=md_slider)  # -> out, a, anchor, uVec, vVec; inputs s: Surface, uv: Point3d
# ---------- python_2: Python ----------
import Rhino

uS,uE = s.Domain(0)
inter0 = Rhino.Geometry.Interval(-uE, -uS)
s.SetDomain(0,inter0)
s = s.Reverse(0)

vS,vE = s.Domain(1)
inter1 = Rhino.Geometry.Interval(-vE, -vS)
s.SetDomain(1,inter1)
s = s.Reverse(1)


a = s.PointAt(uv[0],uv[1])

anchor = s.PointAt(0,0)
uend = s.PointAt(0.5,0)
vend = s.PointAt(0,0.5)
uVec = uend - anchor
vVec = vend - anchor
# ---------- end python_2 ----------
vdisex = VectorDisplayEx(Point=python.anchor, Vector=python.uVec, Colour=u, Width=2)
vdisex_2 = VectorDisplayEx(Point=python.anchor, Vector=python.vVec, Colour=v, Width=2)
pt = Point(python.a)
vdisex_3 = VectorDisplayEx(Point=python_2.anchor, Vector=python_2.uVec, Colour=u, Width=2)
vdisex_4 = VectorDisplayEx(Point=python_2.anchor, Vector=python_2.vVec, Colour=v, Width=2)
pt_2 = Point(python_2.a)
srf_3 = Surface(reparameterize(<surface referenced from the Rhino model>))
srf_4 = Surface(reparameterize(<surface referenced from the Rhino model>))
python_3 = PythonScript(s=srf_3, uv=md_slider)  # -> out, a, anchor, uVec, vVec; inputs s: Surface, uv: Point3d
# ---------- python_3: Python ----------
s = s.Transpose()
a = s.PointAt(uv[0],uv[1])

anchor = s.PointAt(0,0)
uend = s.PointAt(0.5,0)
vend = s.PointAt(0,0.5)
uVec = uend - anchor
vVec = vend - anchor
# ---------- end python_3 ----------
python_4 = PythonScript(s=srf_4, uv=md_slider)  # -> out, a, anchor, uVec, vVec; inputs s: Surface, uv: Point3d
# ---------- python_4: Python ----------
import Rhino

uS,uE = s.Domain(0)
inter0 = Rhino.Geometry.Interval(-uE, -uS)
s.SetDomain(0,inter0)
s = s.Reverse(0)

vS,vE = s.Domain(1)
inter1 = Rhino.Geometry.Interval(-vE, -vS)
s.SetDomain(1,inter1)
s = s.Reverse(1)

s = s.Transpose()


a = s.PointAt(uv[0],uv[1])

anchor = s.PointAt(0,0)
uend = s.PointAt(0.5,0)
vend = s.PointAt(0,0.5)
uVec = uend - anchor
vVec = vend - anchor
# ---------- end python_4 ----------
vdisex_5 = VectorDisplayEx(Point=python_3.anchor, Vector=python_3.uVec, Colour=u, Width=2)
vdisex_6 = VectorDisplayEx(Point=python_3.anchor, Vector=python_3.vVec, Colour=v, Width=2)
vdisex_7 = VectorDisplayEx(Point=python_4.anchor, Vector=python_4.uVec, Colour=u, Width=2)
vdisex_8 = VectorDisplayEx(Point=python_4.anchor, Vector=python_4.vVec, Colour=v, Width=2)
pt_3 = Point(python_3.a)
pt_4 = Point(python_4.a)
srf_5 = Surface(reparameterize(<surface referenced from the Rhino model>))
srf_6 = Surface(reparameterize(<surface referenced from the Rhino model>))
python_5 = PythonScript(s=srf_5, uv=md_slider)  # -> out, a, anchor, uVec, vVec; inputs s: Surface, uv: Point3d
# ---------- python_5: Python ----------
import Rhino

uS,uE = s.Domain(0)
inter1 = Rhino.Geometry.Interval(-uE, -uS)
s.SetDomain(1,inter1)
s = s.Reverse(1)

a = s.PointAt(uv[0],uv[1])

anchor = s.PointAt(0,0)
uend = s.PointAt(0.5,0)
vend = s.PointAt(0,0.5)
uVec = uend - anchor
vVec = vend - anchor
# ---------- end python_5 ----------
python_6 = PythonScript(s=srf_6, uv=md_slider)  # -> out, a, anchor, uVec, vVec; inputs s: Surface, uv: Point3d
# ---------- python_6: Python ----------
import Rhino

uS,uE = s.Domain(0)
inter0 = Rhino.Geometry.Interval(-uE, -uS)
s.SetDomain(0,inter0)
s = s.Reverse(0)
s = s.Transpose()

a = s.PointAt(uv[0],uv[1])

anchor = s.PointAt(0,0)
uend = s.PointAt(0.5,0)
vend = s.PointAt(0,0.5)
uVec = uend - anchor
vVec = vend - anchor
# ---------- end python_6 ----------
vdisex_9 = VectorDisplayEx(Point=python_5.anchor, Vector=python_5.uVec, Colour=u, Width=2)
vdisex_10 = VectorDisplayEx(Point=python_5.anchor, Vector=python_5.vVec, Colour=v, Width=2)
vdisex_11 = VectorDisplayEx(Point=python_6.anchor, Vector=python_6.uVec, Colour=u, Width=2)
vdisex_12 = VectorDisplayEx(Point=python_6.anchor, Vector=python_6.vVec, Colour=v, Width=2)
pt_5 = Point(python_5.a)
pt_6 = Point(python_6.a)
srf_7 = Surface(reparameterize(<surface referenced from the Rhino model>))
srf_8 = Surface(reparameterize(<surface referenced from the Rhino model>))
python_7 = PythonScript(s=srf_7, uv=md_slider)  # -> out, a, anchor, uVec, vVec; inputs s: Surface, uv: Point3d
# ---------- python_7: Python ----------
import Rhino

s = s.Transpose()

uS,uE = s.Domain(0)
inter0 = Rhino.Geometry.Interval(-uE, -uS)
s.SetDomain(0,inter0)
s = s.Reverse(0)

a = s.PointAt(uv[0],uv[1])

anchor = s.PointAt(0,0)
uend = s.PointAt(0.5,0)
vend = s.PointAt(0,0.5)
uVec = uend - anchor
vVec = vend - anchor
# ---------- end python_7 ----------
python_8 = PythonScript(s=srf_8, uv=md_slider)  # -> out, a, anchor, uVec, vVec; inputs s: Surface, uv: Point3d
# ---------- python_8: Python ----------
import Rhino

uS,uE = s.Domain(0)
inter0 = Rhino.Geometry.Interval(-uE, -uS)
s.SetDomain(0,inter0)
s = s.Reverse(0)

a = s.PointAt(uv[0],uv[1])

anchor = s.PointAt(0,0)
uend = s.PointAt(0.5,0)
vend = s.PointAt(0,0.5)
uVec = uend - anchor
vVec = vend - anchor
# ---------- end python_8 ----------
vdisex_13 = VectorDisplayEx(Point=python_7.anchor, Vector=python_7.uVec, Colour=u, Width=2)
vdisex_14 = VectorDisplayEx(Point=python_7.anchor, Vector=python_7.vVec, Colour=v, Width=2)
vdisex_15 = VectorDisplayEx(Point=python_8.anchor, Vector=python_8.uVec, Colour=u, Width=2)
vdisex_16 = VectorDisplayEx(Point=python_8.anchor, Vector=python_8.vVec, Colour=v, Width=2)
pt_7 = Point(python_7.a)
pt_8 = Point(python_8.a)
