# Grasshopper definition Caroline e Thalia_brise.gh (Grasshopper 1.0.7)

point = Point(Point(-7.751816771, -21.2543448, 0))
curve = Curve(<curve referenced from the Rhino model>)
python_script = PythonScript(
    p1=point,
    L_Guia=curve,
    Qtd=Slider(21, range=0..30),
    Larg=Slider(2.16, range=0..5),
    Alt=Slider(4, range=0..5),
    B_alt=Slider(0.03, range=0..5),
    B_larg=Slider(0.2, range=0..5),
    haletas=Slider(17, range=0..30),
    Angulo=Slider(45, range=0..90),
    Alt_haleta=Slider(0.07, range=0..1),
    Larg_haleta=Slider(0.05, range=0..5))  # -> out, eixos, Base, Brise, montante, Haleta; inputs p1: Point3d, Qtd: Int32
# ---------- python_script: Python ----------
import rhinoscriptsyntax as rs
from Rhino.Geometry import Point3d, Vector3d, Plane

#Phyton desenvolvido por 
#Caroline Reis - carolinesreiss@gmail.com
#Thalia Silva - thaliataperoa@hotmail.com 
#como atividade de conclusão de
#do curso Lógica de programação aplicada à criação e análise da forma  ministrado pelo professor Fernando Ribeiro


#Função para criar retângulos base nos planos dos Montantes
def Sect(plans, alt, larg):
    recList = []
    for i in plans:
        rtg = rs.AddRectangle(i ,alt,larg)
        rtg = rs.MoveObject(rtg,  (i.YAxis * -larg/2) + (i.XAxis * - alt/2) )

        recList.append(rtg)
    
    sec = rs.AddPlanarSrf(recList)
    return sec

#Divisão da curva-guia 
lt_Pts = rs.DivideCurve(L_Guia,Qtd)

#Criação dos Eixos dos Montantes
Eixos = []
for i in lt_Pts:
    pAux = i + Vector3d(0,0,Alt)
    lAux = rs.AddLine(i,pAux)
    Eixos.append(lAux)
    
#Criação de Planos nos eixos dos Montantes
p1 = []
for i in range(len(Eixos)):
    Plan = Plane(lt_Pts[i],Vector3d.ZAxis)
    p1.append(Plan)

#Criação das bases retângulares usando a Função Sect
Base = Sect(p1, B_alt, B_larg)
montante = []
#Extrude por meio dos retângulos base para criação dos Montantes
for i in range(len(Eixos)):
    mont1 = rs.ExtrudeSurface(Base[i], Eixos[i])
    montante.append(mont1)

#Divisão dos Eixos/ Definir a quantidade de Haletas dos Brises    
div_temp = []
for i in range(len(Eixos)):
    Div_Brise = rs.DivideCurve(Eixos[i],haletas)
    div_temp.append(Div_Brise)

#Criação de linhas de Eixos das Haletas
eixos_haletas =[]
for i in range(len(div_temp)-1):
    for j in range(1,len(div_temp[i])):
        line_temp = rs.AddLine(div_temp[i][j], div_temp[i+1][j])
        eixos_haletas.append(line_temp)

#Saídas dos elementos de Eixo
eixos = Eixos
Brise = eixos_haletas

#Criação dos planos em cada Haleta e Rotação dos plano no ângulo definido para o Brise
planoHaleta = []
for i in range(len(eixos_haletas)):
    temp_stp = rs.CurveStartPoint(eixos_haletas[i])
    temp_edp = rs.CurveEndPoint(eixos_haletas[i])

    temp_p_haletas = rs.PlaneFromNormal( temp_stp , rs.VectorCreate(temp_edp, temp_stp ) , Vector3d(0,0,1))
    temp_p_haletas = rs.RotatePlane(temp_p_haletas, -Angulo,temp_p_haletas.ZAxis)
    planoHaleta.append(temp_p_haletas)

#Criação dos retângulos-base para as Haletas
baseHaleta = Sect(planoHaleta, Larg_haleta, Alt_haleta)
#Extrude e criação das Haletas
HT_Brise = []
for i in range(len(eixos_haletas)):
    ht1 = rs.ExtrudeSurface(baseHaleta[i], eixos_haletas[i])
    HT_Brise.append(ht1)
#Saída das Haletas
Haleta= HT_Brise
# ---------- end python_script ----------
data = Data(python_script.Haleta)
panel = Panel(python_script.Brise)
