# Grasshopper definition paredeBlocosRotacao_IvanLeo.gh (Grasshopper 0.9.76)
# plug-ins: Python Interpreter

comprimento_do_bloco = Slider(0.45, range=0.12..0.45)
altura_do_bloco = Slider(0.14, range=0.07..0.15)
altura_da_parede = Slider(4.5, range=0.2..20)
largura_do_bloco = Slider(0.141, range=0.07..0.15)
pt = Point(<point referenced from the Rhino model>)
curve = Curve(<curve referenced from the Rhino model>)
python_script = PythonScript(
    curva=curve,
    compBloco=comprimento_do_bloco,
    largBloco=largura_do_bloco,
    hBloco=altura_do_bloco,
    hParede=altura_da_parede,
    ptAtrator=pt)  # -> out, listaBloco; inputs curva: Curve, ptAtrator: Point3d
# ---------- python_script: Python ----------
#TRABALHO DO CURSO DE EXTENSÃO 2018.2
#LEONARDO DINIZ DE MORAIS: lecodim@gmail.com, (71)99974-0868
#IVAN CEZANNE: ivancezanne@gmail.com, (71)99334-9021

import rhinoscriptsyntax as rs
import random
from Rhino.Geometry import Point3d, Vector3d, Plane

#lista de blocos:
listaBloco = []
#cálculo de número de fiadas para altura desejada (aproximada) da parede:
nFiadas = int(hParede//hBloco) 
hFiada = [] #lista com altura de cada fiada

#Dividindo a curva de acordo com comprimento do bloco
listaDiv = rs.DivideCurve(curva, rs.CurveLength(curva)/(compBloco/2))


for fiada in range(nFiadas):
    #zTemp é a altura da fiada (fiada 0, 1, 2.. multiplicada pela altura do bloco)
    zTemp=fiada*hBloco
    hFiada.append(zTemp)
    for seg in range(fiada%2,len(listaDiv)-2,2):
        #criação de retângulos a partir de planos. 
        #Cada plano tem como ponto de origem o ponto de divisão da curve (listaDiv) 
        #de índice par (no caso de fiada par) ou ímpar (para fiadas ímpares)
        plano = rs.PlaneFromNormal ((listaDiv[seg+1]+Point3d(0,0,zTemp)),
                                        Vector3d(0,0,1),
                                        rs.VectorCreate(listaDiv[seg], listaDiv[seg+2]))
        retangulo = rs.AddRectangle(plano, compBloco, largBloco)
        #utilização do atract point - distância em relação ao ponto de origem do plano
        dist = rs.Distance(listaDiv[seg+1]+Point3d(0,0,zTemp),ptAtrator+Point3d(0,0,zTemp))
        #é necessário mover o retângulo criado para o centro do plano:
        retangulo = rs.MoveObject(retangulo, plano.YAxis*(-largBloco/2))
        #Rotação das fiadas ímpares de acordo com atract point
        if fiada%2==1:
            retangulo = rs.RotateObject(retangulo,listaDiv[seg],dist*20)
        #criação de volumes dos blocos a partir dos retângulos:
        bloco = rs.ExtrudeCurve(retangulo, rs.AddLine(listaDiv[seg+1],listaDiv[seg+1]+Point3d(0,0,hBloco)))
        rs.CapPlanarHoles(bloco)
        listaBloco.append(bloco)

#Próximos passos possíveis: 
    #parâmetro sim/não para rotação aleatória dos blocos
    #normalização dos ângulos de rotação dos blocos
# ---------- end python_script ----------
