# Grasshopper definition brick wall.gh (Grasshopper 0.9.76)

n_tijolos_altura = Slider(28, range=0..100)
n_tijolos_compr = Slider(22, range=0..100)
profundidade_mm = Slider(1018, range=0..10000)

# ---- group: TIJOLO
comprimento = Slider(230, range=1..300)
largura = Slider(110, range=1..300)
altura = Slider(76, range=1..300)
rectangle = Rectangle(Plane=PlaneXY(0, 0, 0), XSize=comprimento, YSize=largura, Radius=0)  # -> Rectangle, Length
box_rectangle = BoxRectangle(Rectangle=rectangle.Rectangle, Height=altura)

# ----
construct_domain = ConstructDomain(DomainStart=0, DomainEnd=profundidade_mm)
random = Random(Range=construct_domain, Number=n_tijolos_compr, Seed=2)
series = Series(Start=0, Step=expr("x*1.5", comprimento), Count=n_tijolos_compr)
cull_nth = CullNth(List=random, CullFrequency=2)
cull_nth_2 = CullNth(List=series, CullFrequency=2)
construct_point = ConstructPoint(XCoordinate=cull_nth_2, YCoordinate=cull_nth, ZCoordinate=0)
interpolate = Interpolate(Vertices=construct_point, Degree=3, Periodic=False, KnotStyle=1)  # -> Curve, Length, Domain
