# Grasshopper definition malha 01.gh (Grasshopper 1.0.4)

pt = Point(Point(0, 0, 0))
python_malha_de_pontos = PythonScript(
    O=pt,
    Dx=Slider(3.11, range=0..10),
    Nx=Slider(10, range=0..100),
    Dy=Slider(3.34, range=0..10),
    Ny=Slider(6, range=0..100))  # -> out, P; inputs Nx: Int32, Ny: Int32
# ---------- python_malha_de_pontos: Python ----------
#Curso de Extensão:
#Lógica de programação aplicada à criação e análise da forma
#UFBa - Faculdade de Arquitetura - 2017.1
#Coordenador: Arivaldo Leão de Amorim
#Professor: Fernando Ferraz Ribeiro
#Exemplo de malha regular de pontos

#importando modulos
import rhinoscriptsyntax as rs

#--- Entradas:
#O origem da malha -- (item, ghdoc)
#Dx distância em x dos prontos da malha -- (item, float)
#Nx número de pontos da manha na direção x -- (item, int)
#Dy distância em y dos prontos da malha -- (item, float)
#Ny número de pontos da manha na direção y -- (item, int)

#-- Tratando entradas:
# caso a entrada O não seja alimentada...
if not O:
    #... é criado um ponto nas coordenas (0,0,0)
    #    para ser usado como a origem da malha
    O = rs.AddPoint([0, 0, 0])

#--- Saidas:
# P - lista com os pontos da malha
P = []

#--- Função principal:

#- Loop x
for i in range(Nx):
    #- Loop y
    for j in range(Ny):
        #cria um ponto para a malha
        pt = rs.PointAdd(O,[(i*Dx), (+j*Dy), 0])
        #coloca o ponto na lista de saidas
        P.append(pt)
#--- FIM
# ---------- end python_malha_de_pontos ----------
Z = UnitZ(Factor=Slider(7.47, range=0..10))
move = Move(Geometry=python_malha_de_pontos.P, Motion=Z)  # -> Geometry, Transform
panel = Panel(python_malha_de_pontos.P)
ln = Line(StartPoint=python_malha_de_pontos.P, EndPoint=move.Geometry)
panel_2 = Panel(move.Geometry)
pipe = Pipe(Curve=ln, Radius=Slider(0.22, range=0..10), Caps="1")
panel_3 = Panel(ln)
panel_4 = Panel(pipe)
