# Grasshopper definition malha 02.gh (Grasshopper 0.9.76)
# plug-ins: Python Interpreter

panel = Panel("""3
3
5
3""")
dup = DuplicateData(Data=Slider(6.68, range=0..10), Number=Slider(4, range=0..100), Order=True)
pt = Point(Point(0, 0, 0))
python_malha_vãos = PythonScript(O=pt, Lx=panel, Ly=dup)  # -> out, P; inputs Lx: list, Ly: list
# ---------- python_malha_vãos: Python ----------
#----MALHA DE PONTOS
#- o programa gera uma malha de pontos em x,y
# ssa 15 de jul de 2017

#--- Importando modulos
import rhinoscriptsyntax as rs

#--- Entradas:
#O origem da malha -- (item, ghdoc)
#Lx Listas de vãos no sentido x -- (list, float)
#Ly Listas de vãos no sentido y -- (list, float)

#-- Tratando entradas:
# caso a entrada O não seja alimentada...
if not O:
    #... é criado um ponto nas coordenas (0,0,0)
    #    para ser usado como a origem da malha
    O = rs.AddPoint([0, 0, 0])

#--- Saidas:
# P - lista com os pontos da malhaa
P = []

#--- Função principal:
#- Manipulando listas
# Acrescentando valor 0 no início da lista de vãos Lx
Lx.insert(0,0.0)
# Acrescentando valor 0 no início da lista de vãos Ly
Ly.insert(0,0.0)
#- limpando variavel xAux para Loop x
xAux = 0.0
#- Loop x
for i in range(len(Lx)):
    xAux = xAux + Lx[i]
    #- limpando variavel yAux para Loop y
    yAux = 0.0
    #- Loop y
    for j in range(len(Ly)):
        yAux = yAux + Ly[j]
        #cria um ponto com as coordenadas xAux, yAux
        ptAux = rs.AddPoint(xAux,yAux,0)
        #cria o ponto da malha somando o ponto ptAux ao ponto O
        pt = rs.PointAdd(O,ptAux)
        #coloca o ponto na lista de saidas
        P.append(pt)
#--- FIM
# ---------- end python_malha_vãos ----------
Z = UnitZ(Factor=Slider(7.47, range=0..10))
move = Move(Geometry=python_malha_vãos.P, Motion=Z)  # -> Geometry, Transform
panel_2 = Panel(python_malha_vãos.P)
ln = Line(StartPoint=python_malha_vãos.P, EndPoint=move.Geometry)
panel_3 = Panel(move.Geometry)
pipe = Pipe(Curve=ln, Radius=Slider(0.22, range=0..10), Caps="1")
panel_4 = Panel(ln)
panel_5 = Panel(pipe)
