# Grasshopper definition treliça 01.gh (Grasshopper 1.0.4)

number_slider = Slider(0.16, range=0..1)
curve = Curve(<curve referenced from the Rhino model>)
treliça_01_py = PythonScript(C1=curve, C2=Slider(4.268, range=0..5), N1=Slider(19, range=0..100), OfSup=number_slider, OfInf=number_slider)  # -> out, Bsup, Diag, Binf, Cordas; inputs N1: Int32
# ---------- treliça_01_py: Python ----------
#Curso de Extensão:
#Lógica de programação aplicada à criação e análise da forma
#UFBa - Faculdade de Arquitetura - 2017.1
#Coordenador: Arivaldo Leão de Amorim
#Professor: Fernando Ferraz Ribeiro
#Exemplo treliça a partir do(s) eixos dos banzos

#Importando Módulos
import rhinoscriptsyntax as rs

#entradas


#Saidas
Cordas =[]
Diag =[]
Bsup =[]
Binf = []



# versor Z auxiliar
vrZ= rs.VectorCreate([0,0,1],[0,0,0])

# -> Tratando variáveis
# Se o numero de divisões não foi lido...
if not N1:
    # ... considerar N1 = 10
    N1 = 10

# se a entrada C2 contem um valor numérico
if type(C2) == float:
    # criar um offset da curva C1 na distância C2
    # na direção oposta ao versor Z auxiliar
    C2 = rs.OffsetCurve(C1,vrZ,C2)

if OfSup:

    C1 = rs.OffsetCurve(C1,vrZ,OfSup)

if OfInf :

    C2 = rs.OffsetCurve(C2,vrZ,-OfInf)

# --> Métodos

# -> Método que desenha as cordas verticais
def EixosVert(lp1, lp2): #recebe duas listas de pontos
    ev = []
    # Cria lista de pontos entre as lista de pontos
    for i in range(len(lp1)):
        lAux = rs.AddLine(lp1[i],lp2[i])
        ev.append(lAux)
    return ev
    
# -> Fim do metodo
    

# -> metodo que desenha o eixo das diagonais
def EixoCordas(banSup, banInf, num):
    # lista de pontos que dividem o banzo superior
    # em num segmentos
    pointsC1 = rs.DivideCurve(banSup,num)
    # lista de pontos que dividem o banzo inferior
    # em num segmentos
    pointsC2 = rs.DivideCurve(banInf,num)
  
    cordas = EixosVert(pointsC1, pointsC2 )

        
        
    
    # lista dos pontos de indice par do banzo sup
    banSupPt = pointsC1[0::2]
    # lista dos pontos de indice impar do banzo inf
    banInfPt = pointsC2[1::2]
    
    # lista vazia com tamanho igula a banSupPt + banInfPt
    diagPt = [None]*(len(banSupPt)+len(banInfPt))
    
    # intercalando as listas
    diagPt[::2] = banSupPt
    diagPt[1::2] = banInfPt
    
    # desenha polyline entre os pontos intercalados
    eixoDiag = rs.AddPolyline(diagPt)
    # retorna os eixos
    return [eixoDiag] , cordas
# -> Fim do metodo

# --> Função Principal
Diag, Cordas = EixoCordas(C1, C2, N1)

Bsup = C1

Binf = C2

# --> Fim
# ---------- end treliça_01_py ----------
number_slider_2 = Slider(0.37, range=0..1)
merge = Merge(Data1=treliça_01_py.Bsup, Data2=treliça_01_py.Diag, Data3=treliça_01_py.Binf, Data4=treliça_01_py.Cordas)
perfil_retangular_py = PythonScript(Eixo=merge, Ex=number_slider_2, Ey=number_slider_2)  # -> out, perfil, Diag, Binf, Cordas; inputs Eixo: Curve
# ---------- perfil_retangular_py: Python ----------
#Importando Módulos
import rhinoscriptsyntax as rs

Barras = []

# versor Z auxiliar
vrZ= rs.VectorCreate([0,0,0],[0,0,1])

normal = rs.CurveTangent(Eixo, 0,)

vecBase = rs.VectorCrossProduct(vrZ, normal)
if vecBase == rs.VectorCreate([0,0,0],[0,0,0]):
    plAux = rs.PlaneFromNormal(rs.CurveStartPoint(Eixo), normal)
else:
    plAux = rs.PlaneFromNormal(rs.CurveStartPoint(Eixo), normal, vecBase)
o1, x1, y1, z1 = plAux
vAux = rs.VectorAdd((-Ex/2)*x1,(-Ey/2)*y1)

pOrig = rs.PointAdd( o1, vAux)
plAux = rs.MovePlane( plAux, pOrig)
perfil = rs.AddRectangle(plAux, Ex, Ey)

Diag = rs.AddSweep1(Eixo, [perfil])
# ---------- end perfil_retangular_py ----------
