# Grasshopper definition teste meerkat.gh (Grasshopper 0.9.76)
# plug-ins: MeerkatGIS

file_path = FilePath("C:\Users\ffrib\Desktop\fernando_ssa.mkgis")
parse_meerkat_file = ParseMeerkatFile(MeerkatFile=file_path)  # -> DateCropped, UserAndMachineNamed, PathForFiles, ShapeType, ShapeCountInSource, BoundsInPointSpace, BoundsInLatLong, FieldNames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
construct_point = ConstructPoint(XCoordinate=0, YCoordinate=0, ZCoordinate=0)
import_shapefile = ImportShapefile(Power=Toggle(False))
panel = Panel(parse_meerkat_file.GeometryPerShape)
area = Area(Geometry=parse_meerkat_file.BoundsInPointSpace)  # -> Area, Centroid
panel_2 = Panel(parse_meerkat_file.ShapeIDInSource)
panel_3 = Panel(parse_meerkat_file.FieldValuesPerShape)
vector_2pt = Vector2Pt(PointA=area.Centroid, PointB=construct_point, Unitize=False)  # -> Vector, Length
list_item = ListItem(List=parse_meerkat_file.FieldValuesPerShape, Index="1", Wrap=True)
panel_4 = Panel(parse_meerkat_file.FieldNames)
move = Move(Geometry=parse_meerkat_file.GeometryPerShape, Motion=vector_2pt.Vector)  # -> Geometry, Transform
unit_z = UnitZ(Factor=list_item)
panel_5 = Panel(list_item)
move_2 = Move(Geometry=move.Geometry, Motion=unit_z)  # -> Geometry, Transform
patch = Patch(Points=flatten(move_2.Geometry), Spans=20, Flexibility=1, Trim=True)
