# Grasshopper definition teste pavimentos.gh (Grasshopper 0.9.76)
# plug-ins: Python Interpreter

# Doubleclick Me!
duplicate_data = DuplicateData(Data=Slider(3.92, range=0..100), Number=Slider(6, range=0..10), Order=True)
insert_items = InsertItems(List=duplicate_data, Item=0, Indices=0, Wrap=True)
mass_addition = MassAddition(Input=insert_items)  # -> Result, PartialResults
unit_z = UnitZ(Factor=mass_addition.PartialResults)
panel = Panel(mass_addition.PartialResults)
point = Point(Point(1.373971447, -0.1873597428, 0))
point_2 = Point(Point(19.11069377, 10.05497286, 0))
move = Move(Geometry=point, Motion=unit_z)  # -> Geometry, Transform
move_2 = Move(Geometry=point_2, Motion=unit_z)  # -> Geometry, Transform
unit_z_2 = UnitZ(Factor=1)
python_script = PythonScript(x=move.Geometry, y=move_2.Geometry)  # -> out, a; inputs x: Point3d, y: Point3d
# ---------- python_script: Python ----------
import rhinoscriptsyntax as rs

a = rs.AddLine(x,y)
# ---------- end python_script ----------
cross_product = CrossProduct(VectorA=python_script.a, VectorB=unit_z_2, Unitize=True)  # -> Vector, Length
multiplication = Multiplication(A=cross_product.Vector, B=Slider(51.25, range=0..300))
extrude = Extrude(Base=python_script.a, Direction=multiplication)
